# Grasshopper definition comfort_mapping.gh (Grasshopper 1.0.7)

# ---- group: Context!
brep = Brep([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])
shade = HBShade(geo=brep)  # -> report, shades; plug-in component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

# ----
toggle = BooleanToggle(True)

# ---- group: Opaque Faces
geo = Geometry([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])
intsolid = HBIntersectSolids(solids=flatten(geo), run=Toggle(True))  # -> int_solids; plug-in component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
roomsolid = HBRoomFromSolid(
    geo=flatten(intsolid),
    name="TestRoom",
    constr_set="2013::ClimateZone5::SteelFramed",
    program="2013::LargeOffice::OpenOffice",
    conditioned=True)  # -> report, rooms; plug-in component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
solveadj = HBSolveAdjacency(rooms=flatten(roomsolid.rooms), air_boundary=toggle, run=toggle)  # -> report, adj_rooms; plug-in component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

# ---- group: Apertures
# Geometry Preparation
brep_2 = Brep([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])
aperture = HBAperture(geo=brep_2)  # -> report, apertures; plug-in component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
addsubface = HBAddSubface(hb_obj=flatten(solveadj.adj_rooms), sub_faces=flatten(aperture.apertures))  # -> hb_obj; plug-in component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
bordershades = HBExtrudedBorderShades(hb_objs=flatten(addsubface), depth="0.3")  # -> report, hb_objs; plug-in component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

# ----
# Model
# + Grids
panel = Panel("sample_model_grid")
model = HBModel(rooms=flatten(bordershades.hb_objs), shades=flatten(shade.shades), name=panel)  # -> report, model; plug-in component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
gridrooms = HBSensorGridFromRooms(rooms=bordershades.hb_objs, grid_size="1")  # -> grid, points, mesh; plug-in component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
assigngridsviews = HBAssignGridsAndViews(model=model.model, grids=flatten(gridrooms.grid))  # -> model; plug-in component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
vizwiref = HBVisualizeWireframe(hb_objs=flatten(model.model))  # -> geo; plug-in component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

# ----
# EPW
panel_2 = Panel("https://energyplus-weather.s3.amazonaws.com/north_and_central_america_wmo_region_4/USA/MA/USA_MA_Boston-Logan.Intl.AP.725090_TMY3/USA_MA_Boston-Logan.Intl.AP.725090_TMY3.zip")
downloadepw = LBDownloadWeather(weather_URL=panel_2)  # -> epw_file, stat_file, ddy_file; plug-in component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

# ----
# Run Recipe
panel_3 = Panel("0.8")
pmvmap = HBPMVComfortMap(model=assigngridsviews, epw=downloadepw.epw_file, ddy=downloadepw.ddy_file, clo_value=panel_3, run=Toggle(False))  # -> report, env_conds, temperature, condition, pmv, TCP, HSP, CSP; plug-in component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

# ----
# Visualize Heat and Cold Sensation
panel_4 = Panel("""10
11""")
colrange = LBColorRange(index=panel_4)  # -> colors; plug-in component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
mjoin = MeshJoin(Meshes=gridrooms.mesh)
legendpar = LBLegendParameters(colors=colrange)  # -> leg_par; plug-in component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
move = Move(Geometry=mjoin, Motion="40,0,0")  # -> Geometry, Transform
move_2 = Move(Geometry=vizwiref, Motion="40,0,0")  # -> Geometry, Transform
bang = ExplodeTree(Data=simplify(legendpar))  # -> Branch0, Branch1
heatmap = LBSpatialHeatmap(values=flatten(pmvmap.HSP), mesh=mjoin, legend_par=bang.Branch0, legend_title="%")  # -> mesh, legend, title, colors, legend_par; plug-in component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
heatmap_2 = LBSpatialHeatmap(values=flatten(pmvmap.CSP), mesh=move.Geometry, legend_par=bang.Branch1, legend_title="%")  # -> mesh, legend, title, colors, legend_par; plug-in component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

# ----
# Load Temperature Data
thermalmtx = HBReadThermalMatrix(comf_result=pmvmap.temperature, load=Toggle(True))  # -> comf_mtx; plug-in component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
vizthermalmap = HBVisualizeThermalMap(comf_mtx=thermalmtx, mesh=flatten(gridrooms.mesh))  # -> report, mesh, legend, title, colors, values; plug-in component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

envmtx = HBReadEnvironmentMatrix(env_conds=pmvmap.env_conds, metric="MRT", load=Toggle(False))  # -> comf_mtx; plug-in component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
