# Grasshopper definition creating_schedules.gh (Grasshopper 1.0.7)

# ----
# Create Weekly Schedule
dayschedule = HBDaySchedule(
    Decimals=1,
    Maximum=1,
    Minimum=0,
    Value=[0, 0, 0, 0, 0, 0, 0, 0, 0, 0.1, 0.3, 0.3, 0.3, 0.3, 0.3, 0.3, 0.2, 0.1, 0, 0, 0, 0, 0, 0])
dayschedule_2 = HBDaySchedule(
    Decimals=1,
    Maximum=1,
    Minimum=0,
    Value=[0, 0, 0, 0, 0, 0, 0, 0.1, 0.8, 1, 1, 1, 1, 1, 1, 1, 1, 0.8, 0.3, 0.3, 0.1, 0, 0, 0])
weeklyschedule = HBWeeklySchedule(
    sun="0",
    mon=dayschedule_2,
    tue=dayschedule_2,
    wed=dayschedule_2,
    thu=dayschedule_2,
    fri=dayschedule_2,
    sat=dayschedule,
    name="OfficeOccupancyNormal")  # -> report, schedule, idf_year, idf_week, idf_days; plug-in component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

# ----
# Create Constant (Repeating Daily) Schedule
dayschedule_3 = HBDaySchedule(
    Decimals=1,
    Maximum=1,
    Minimum=0,
    Value=[0, 0, 0, 0, 0, 0, 0, 0.1, 0.8, 1, 1, 1, 1, 1, 1, 1, 1, 0.8, 0.3, 0.3, 0.1, 0, 0, 0])
genepooltodaysch = HBGenePoolToDaySchedule(gene_pool=dayschedule_3, run=Toggle(False))  # -> report; plug-in component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
constantschedule = HBConstantSchedule(values=dayschedule_3, name="OfficeOccupancyCrunchTime")  # -> report, schedule, idf_text; plug-in component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

# ----
# Create Seasonal Schedule
panel = Panel("6")
analysisperiod = LadybugPlus_AnalysisPeriod(start_month=panel, start_day=1, start_hour=0, end_month=panel)  # -> analysis_period, hoys, dates; plug-in component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
seasonalschedule = HBSeasonalSchedule(
    base_schedule=weeklyschedule.schedule,
    season_scheds=constantschedule.schedule,
    analysis_periods=analysisperiod.analysis_period,
    name="OfficeOccupancyWithCrunch")  # -> report, schedule, idf_year, idf_week, idf_days; plug-in component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
panel_2 = Panel(seasonalschedule.schedule)

# ----
# Create Fixed Interval Schedule
cluster = Cluster()  # -> D, S_2, D_2, S
data = Data([cluster.D, cluster.S_2, cluster.D_2, cluster.S])
fixedintervalschedule = HBFixedIntervalSchedule(values=data, name="GradualTransparencyShift")  # -> report, schedule; plug-in component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
panel_3 = Panel(fixedintervalschedule.schedule)
panel_4 = Panel(data)

# ----
# Deconstruct Schedues
panel_5 = Panel("Monday")
schtodata = HBScheduleToData(schedule=weeklyschedule.schedule, week_start_day=panel_5, holidays="1 Jan")  # -> data; plug-in component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
deconstrsch = HBDeconstructSchedule(schedule=weeklyschedule.schedule)  # -> day_names, day_data, type_limit; plug-in component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

# ----
# Create ScheduleTypeLimits
panel_6 = Panel("Fan Speed")
typelimit = HBTypeLimit(name=panel_6, low_limit="0", unit_type="Velocity")  # -> report, type_limit; plug-in component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
panel_7 = Panel(typelimit.type_limit)

# ----
# Search Schedule Library
searchschs = HBSearchSchedules()  # -> schedules, type_limits; plug-in component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
panel_8 = Panel(searchschs.schedules)

# ----
# Assign Schedues
applyroomsch = HBApplyRoomSchedules()  # -> report, mod_obj; plug-in component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
applyshadesch = HBApplyShadeSchedule()  # -> hb_objs; plug-in component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

# ==== cluster Cluster
division = Division(A="1", B="2190")
neg = Negative(Value=division)
dup = DuplicateData(Data="0", Number="2190", Order=True)
dup_2 = DuplicateData(Data="1", Number="2190", Order=True)
series = Series(Start="1", Step=neg, Count="2190")
series_2 = Series(Start=0, Step=division, Count="2190")
S = ClusterOutput(series)
S_2 = ClusterOutput(series_2)
D = ClusterOutput(dup)
D_2 = ClusterOutput(dup_2)
