# Grasshopper definition daylight_into_energy.gh (Grasshopper 1.0.7)

# ---- group: Opaque Faces
geo = Geometry([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])
roomsolid = HBRoomFromSolid(geo=flatten(geo), name="TestRoom", conditioned=True)  # -> report, rooms; plug-in component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

# ---- group: Apertures
# Geometry Preparation
panel = Panel("g_material")
glassmod = HBGlassModifier(name=panel, trans="0.55")  # -> modifier; plug-in component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
brep = Brep([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])
aperture = HBAperture(geo=brep, rad_mod=glassmod)  # -> report, apertures; plug-in component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
addsubface = HBAddSubface(hb_obj=flatten(roomsolid.rooms), sub_faces=flatten(aperture.apertures))  # -> hb_obj; plug-in component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
bordershades = HBExtrudedBorderShades(hb_objs=flatten(addsubface), depth="0.3")  # -> report, hb_objs; plug-in component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

# ----
# Model + Grids
panel_2 = Panel("sample_model_grid")
model = HBModel(rooms=flatten(bordershades.hb_objs), name=panel_2)  # -> report, model; plug-in component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
gridrooms = HBSensorGridFromRooms(rooms=bordershades.hb_objs, grid_size="1")  # -> grid, points, mesh; plug-in component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
assigngridsviews = HBAssignGridsAndViews(model=model.model, grids=flatten(gridrooms.grid))  # -> model; plug-in component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
vizwiref = HBVizualizeWireframe(hb_objs=flatten(model.model))  # -> geo; plug-in component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

# ----
# Wea
panel_3 = Panel("https://www.energyplus.net/weather-download/north_and_central_america_wmo_region_4/USA/MA/USA_MA_Boston-Logan.Intl.AP.725090_TMY3/all")
downloadepw = LBDownloadWeather(weather_URL=panel_3)  # -> epw_file, stat_file, ddy_file; plug-in component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
wea = HBWeaFromEPW(epw_file=downloadepw.epw_file)  # -> wea; plug-in component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

# ----
# Run Recipe
panel_4 = Panel("Generic Office Occupancy")
annualdaylight = HBAnnualDaylight(model=assigngridsviews, wea=wea, thresholds="-t 500", schedule=panel_4, sensor_count="30", run=Toggle(False))  # -> report, results, DA, cDA, UDI, UDI_low, UDI_up; plug-in component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

rooms = Data(bordershades.hb_objs)
daylightschedule = HBDaylightControlSchedule(results=annualdaylight.results, base_schedule="Generic Office Lighting", ill_setpoint=250)  # -> schedules; plug-in component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
applyroomsch = HBApplyRoomSchedules(room_or_program=flatten(rooms), lighting_sch=daylightschedule)  # -> report, mod_obj; plug-in component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
toggle = BooleanToggle(False)
model_2 = HBModel(rooms=flatten(applyroomsch.mod_obj))  # -> report, model; plug-in component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
modeltoosm = HBModelToOSM(model=model_2.model, epw_file=downloadepw.epw_file, write=toggle, run=toggle)  # -> report, jsons, osw, osm, idf, sql, zsz, rdd, html; plug-in component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
roomenergyresult = HBReadRoomEnergyResult(sql=modeltoosm.sql)  # -> cooling, heating, lighting, electric_equip, gas_equip, hot_water, fan_electric, pump_electric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; plug-in component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
hourlyplot = LBHourlyPlot(data=roomenergyresult.lighting)  # -> report, mesh, legend, borders, labels, title; plug-in component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
