# Grasshopper definition energy_shade_benefit.gh (Grasshopper 1.0.7)

ladybug = Ladybug_Ladybug()  # -> Vviiiiiiiiiizzz; plug-in component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
# Set Up An Energy Simulation
honeybee = Honeybee_Honeybee()  # -> Vviiiiiiiiiizzz; plug-in component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

# ----
# Set Building Geometry
rectangle = Rectangle(Plane=PlaneXY(0, 0, 0), XSize="10", YSize="10", Radius=0)  # -> Rectangle, Length
skeleton = HBStraightSkeleton(floor_geo=rectangle.Rectangle, offset="3")  # -> polyskel, perim_poly, core_poly; plug-in component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
extr = Extrude(Base=[skeleton.perim_poly, skeleton.core_poly], Direction="0, 0, 3")
roomsolid = HBRoomFromSolid(geo=flatten(extr), conditioned=True)  # -> report, rooms; plug-in component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
solveadj = HBSolveAdjacency(rooms=flatten(roomsolid.rooms), run=Toggle(True))  # -> report, adj_rooms; plug-in component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
aperturesbyratio = HBAperturesByRatio(hb_objs=flatten(solveadj.adj_rooms), ratio="0.9")  # -> report, hb_objs; plug-in component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
louvershades = HBLouverShades(hb_objs=flatten(aperturesbyratio.hb_objs), depth="3")  # -> report, hb_objs; plug-in component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

vizbytype = HBVisualizeByType(hb_objs=louvershades.hb_objs)  # -> walls, interior_walls, roofs, ceilings, exterior_floors, interior_floors, air_walls, apertures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; plug-in component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
# 2
toggle = BooleanToggle(False)

# ----
# Set Building Geometry
toggle_2 = BooleanToggle(True)
brep = Brep(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)
panel = Panel("https://www.energyplus.net/weather-download/north_and_central_america_wmo_region_4/USA/MA/USA_MA_Boston-Logan.Intl.AP.725090_TMY3/all")
toggle_3 = BooleanToggle(True)
number_slider = Slider(24, range=22..28)
number_slider_2 = Slider(19, range=16..20)
epoutput = Honeybee_GenerateEPOutput(
    zoneEnergyUse=toggle_3,
    zoneGainsAndLosses="False",
    zoneComfortMetrics=toggle_3,
    surfaceTempAnalysis="False",
    surfaceEnergyAnalysis=toggle_3,
    glazingSolarAnalysis=toggle_3)  # -> report, flatten(simulationOutputs); plug-in component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

split2zone = Honeybee_SplitFloor2ThermalZones(bldgFloors=flatten(brep), perimeterZoneDepth="3", runIt=toggle_2)  # -> readMe, splitBldgZones; plug-in component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
epw_stat = Ladybug_OpenEPWAndSTATWeatherFiles(weatherFileURL=panel)  # -> epwFile, statFile; plug-in component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
importlocation = Ladybug_ImportLocation(epwFile=epw_stat.epwFile)  # -> location; plug-in component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

mass2zone = Honeybee_Masses2Zones(zoneMasses=flatten(split2zone.splitBldgZones), isConditioned=True, maxRoofAngle=30, createHBZones=Toggle(True))  # -> readMe, HBZones; plug-in component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
solveadjc = Honeybee_SolveAdjacencies(HBZones=flatten(mass2zone.HBZones), removeCurrentAdjc=False, findAdjc=Toggle(True))  # -> readMe, HBZonesWADJ; plug-in component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

glazingcreator = Honeybee_GlazingBasedOnRatio(HBObjects=solveadjc.HBZonesWADJ, glzRatio=".9", breakUpWindow=Toggle(False), runIt=Toggle(True))  # -> readMe, HBObjWGLZ; plug-in component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

setepzonethresholds = Honeybee_SetEnergyPlusZoneThresholds(
    HBZones=glazingcreator.HBObjWGLZ,
    coolingSetPt=number_slider,
    coolingSetback=number_slider,
    heatingSetPt=number_slider_2,
    heatingSetback=number_slider_2)  # -> readMe, HBZones; plug-in component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

# ----
# Visualize the Zones
decomposebytype = Honeybee_DecomposeBasedOnType(HBZone=setepzonethresholds.HBZones)  # -> walls, interiorWalls, airWalls, windows, interiorWindows, skylights, roofs, ceilings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; plug-in component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
preview = CustomPreview(Geometry=decomposebytype.windows, Shader=ColourSwatch(SwatchColor=RGBA(178, 232, 255, 108)))
preview_2 = CustomPreview(Geometry=decomposebytype.walls, Shader=ColourSwatch(SwatchColor=RGB(255, 252, 178)))
preview_3 = CustomPreview(Geometry=[decomposebytype.groundFloors, decomposebytype.floors], Shader=ColourSwatch(SwatchColor=RGB(214, 131, 131)))
preview_4 = CustomPreview(Geometry=decomposebytype.roofs, Shader=ColourSwatch(SwatchColor=RGB(128, 128, 128)))

# ----
# Run the Simulation
# 1
toggle_4 = BooleanToggle(False)
# Run the Energy Simulation + Get Results
exporttoopenstudio = Honeybee_ExportToOpenStudio(
    epwWeatherFile=epw_stat.epwFile,
    HBZones=flatten(setepzonethresholds.HBZones),
    simulationOutputs=flatten(epoutput.simulationOutputs),
    writeOSM=toggle_4,
    runSimulation=toggle_4)  # -> readMe, osmFileAddress, idfFileAddress, resultFileAddress, eioFileAddress, rddFileAddress, htmlReport, studyFolder, model; plug-in component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
readepresult = Honeybee_ReadEPResult(resultFileAddress=exporttoopenstudio.resultFileAddress)  # -> totalThermalLoad, thermalLoadBalance, cooling, heating, electricLight, electricEquip, fanElectric, pumpElectric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; plug-in component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
readepsrfresult = Honeybee_ReadEPSurfaceResult(resultFileAddress=exporttoopenstudio.resultFileAddress)  # -> surfaceIndoorTemp, surfaceOutdoorTemp, surfaceEnergyFlow, opaqueEnergyFlow, glazEnergyFlow, windowTotalSolarEnergy, windowBeamEnergy, windowDiffEnergy, windowTransmissivity; plug-in component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

# ----
# Create Shades
epwindowshades = Honeybee_EnergyPlusWindowShadeGenerator(
    HBObjects=flatten(setepzonethresholds.HBZones),
    depth=Slider(3, range=0..10),
    numOfShds="1",
    horOrVertical=Toggle(True),
    runIt=toggle,
    zoneData1=readepresult.cooling,
    zoneData2=readepresult.heating,
    zoneData3=readepsrfresult.windowBeamEnergy)  # -> readMe, port, HBObjWShades, port_2, windowBreps, shadeBreps, port_3, shadeMatName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; plug-in component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

# ----
# 3
toggle_5 = BooleanToggle(False)
# Shade Benefit Analysis
energyshadebenefit = Honeybee_EnergyShadeBenefitEvaluator(
    location=importlocation,
    coolingLoad=epwindowshades.zoneData1Tree,
    heatingLoad=epwindowshades.zoneData2Tree,
    beamGain=epwindowshades.zoneData3Tree,
    testShades=epwindowshades.shadeBreps,
    testWindow=epwindowshades.windowBreps,
    gridSize=".25",
    delNonIntersect=False,
    parallel=Toggle(True),
    runIt=toggle_5)  # -> readMe, port, sunVectors, windowTestPts, shadeMesh, legend, legendBasePoint, port_2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; plug-in component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

# ----
# Select Out The Parts of Shades To Keep
mjoin = MeshJoin(Meshes=flatten(energyshadebenefit.shadeMesh))

meshselector = Ladybug_MeshThresholdSelector(inputMesh=mjoin, analysisResult=flatten(energyshadebenefit.shadeNetEffect), levelOfPerform=Slider(20, range=0..100))  # -> readMe, totalValue, areaMeetsThresh, newColoredMesh, newMeshOutline; plug-in component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
data = Data(flatten(meshselector.areaMeetsThresh))
data_2 = Data(flatten(meshselector.totalValue))
ma = MassAddition(Input=data)  # -> Result, PartialResults
ma_2 = MassAddition(Input=data_2)  # -> Result, PartialResults
panel_2 = Panel(ma.Result)
panel_3 = Panel(ma_2.Result)

preview_5 = CustomPreview(Geometry=meshselector.newMeshOutline, Shader=ColourSwatch(SwatchColor=RGB(0, 0, 0)))
