# Grasshopper definition full_building_energy_model.gh (Grasshopper 1.0.7)

# ----
# Create New ProgramType
panel = Panel("SchoolSecondary HTGSETP_SCH_YES_OPTIMUM")
setpoint = HBSetpoint(name="University Setpoint", heating_sch=panel, cooling_sch="SchoolSecondary CLGSETP_SCH_NO_SETBACK")  # -> setpoint; plug-in component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
ventilation = HBVentilation(name="University Ventilation", flow_per_person="0.01")  # -> vent; plug-in component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
infiltration = HBInfiltration(name="University Infiltration", flow_per_ext_area="0.0003")  # -> infil; plug-in component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
lighting = HBLighting(name="University Lighting", watts_per_area="6", schedule="SchoolPrimary BLDG_LIGHT_GYM_SCH")  # -> lighting; plug-in component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
people = HBPeople(name="University People", ppl_per_area="0.05", occupancy_sch="PrimarySchool Bldg Occ")  # -> people; plug-in component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
equipment = HBEquipment(name="University Equipment", watts_per_area="5", schedule="SchoolPrimary BLDG_EQUIP_SCH_2010")  # -> equip; plug-in component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
programtype = HBProgramType(
    name="University Classroom",
    people=people,
    lighting=lighting,
    electric_equip=equipment,
    infiltration=infiltration,
    ventilation=ventilation,
    setpoint=setpoint)  # -> program; plug-in component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

# ----
# Create New ConstructionSet
interiorsubset = HBInteriorConstructionSubset()  # -> interior_set; plug-in component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
subfacesubset = HBSubfaceSubset()  # -> subface_set; plug-in component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
exteriorsubset = HBExteriorConstructionSubset()  # -> exterior_set; plug-in component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
groundsubset = HBGroundConstructionSubset()  # -> ground_set; plug-in component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
constructionset = HBConstructionSet(
    name="CustomSet",
    exterior_subset=exteriorsubset,
    ground_subset=groundsubset,
    interior_subset=interiorsubset,
    subface_subset=subfacesubset)  # -> constr_set; plug-in component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

# ----
# Construction Set
bldg_vintage = Dragonfly_BldgAge({"ASHRAE 90.1 2013  |  IECC 2015": "2013", "ASHRAE 90.1 2010  |  IECC 2012": "2010", "ASHRAE 90.1 2007  |  IECC 2009": "2007", "ASHRAE 90.1 2004  |  IECC 2006": "2004", "1980-2004 (CBECS)": "1980_2004", "Pre-1980 (CBECS)": "pre_1980"}, selected="ASHRAE 90.1 2013  |  IECC 2015")
constr_type = Dragonfly_BldgAge({"SteelFramed", "WoodFramed", "Mass", "Metal Building"}, selected="SteelFramed")
climate_zone = Dragonfly_BldgAge({"1 - Very Hot": "1", "2 - Hot": "2", "3 - Warm": "3", "4 - Mixed": "4", "5 - Cool": "5", "6 - Cold": "6", "7 - Very Cold": "7", "8 - Subarctic": "8"}, selected="5 - Cool")
searchconstrset = HBSearchConstructionSets(climate_zone=climate_zone, vintage=bldg_vintage, constr_type=constr_type)  # -> constr_set; plug-in component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

# ----
# Search Through ProgramTypes and ConstructionSets
bldgvintages = HBBuildingVintages({"ASHRAE 90.1 2013  |  IECC 2015": "2013", "ASHRAE 90.1 2010  |  IECC 2012": "2010", "ASHRAE 90.1 2007  |  IECC 2009": "2007", "ASHRAE 90.1 2004  |  IECC 2006": "2004", "1980-2004 (CBECS)": "1980_2004", "Pre-1980 (CBECS)": "pre_1980"}, selected="ASHRAE 90.1 2013  |  IECC 2015")
bldgprograms = HBBuildingPrograms({"LargeOffice", "MediumOffice", "SmallOffice", "MidriseApartment", "HighriseApartment", "Retail", "StripMall", "PrimarySchool", "SecondarySchool", "SmallHotel", "LargeHotel", "Hospital", "Outpatient", "Laboratory", "Warehouse", "SuperMarket", "FullServiceRestaurant", "QuickServiceRestaurant", "Courthouse", "LargeDataCenterHighITE", "LargeDataCenterLowITE", "SmallDataCenterHighITE", "SmallDataCenterLowITE"}, selected="LargeOffice")
constructiontypes = HBConstructionTypes({"SteelFramed", "WoodFramed", "Mass", "Metal Building"}, selected="SteelFramed")
climatezones = HBClimateZones({"1 - Very Hot": "1", "2 - Hot": "2", "3 - Warm": "3", "4 - Mixed": "4", "5 - Cool": "5", "6 - Cold": "6", "7 - Very Cold": "7", "8 - Subarctic": "8"}, selected="5 - Cool")
searchconstrset_2 = HBSearchConstructionSets(climate_zone=climatezones, constr_type=constructiontypes)  # -> constr_set; plug-in component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
searchprog = HBSearchPrograms(bldg_prog=bldgprograms, vintage=bldgvintages)  # -> room_prog; plug-in component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
panel_2 = Panel(searchprog)
panel_3 = Panel(searchconstrset_2)

toggle = BooleanToggle(True)

# ----
# Office
panel_4 = Panel("Office")
offices = Geometry([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])
roomsolid = HBRoomFromSolid(
    geo=flatten(offices),
    name=panel_4,
    program="2013::MediumOffice::ClosedOffice",
    constr_set=searchconstrset,
    conditioned=True,
    run=toggle)  # -> report, rooms; plug-in component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

# ----
# Conference
panel_5 = Panel("2013::MediumOffice::Conference")
conference = Geometry([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])
roomsolid_2 = HBRoomFromSolid(geo=flatten(conference), name="Conference", program=panel_5, constr_set=searchconstrset, conditioned=True, run=toggle)  # -> report, rooms; plug-in component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

# ----
# Lab Support
panel_6 = Panel("Lab Support")
research_lab = Geometry([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])
roomsolid_3 = HBRoomFromSolid(
    geo=flatten(research_lab),
    name=panel_6,
    program="2013::Laboratory::Lab with fume hood",
    constr_set=searchconstrset,
    conditioned=True,
    run=toggle)  # -> report, rooms; plug-in component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

# ----
# Classroom
panel_7 = Panel("2013::MediumOffice::Classroom")
classroom = Geometry([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])
roomsolid_4 = HBRoomFromSolid(geo=flatten(classroom), name="Classroom", program=panel_7, constr_set=searchconstrset, conditioned=True, run=toggle)  # -> report, rooms; plug-in component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

# ----
# Writeup
panel_8 = Panel("Writeup")
wrietup = Geometry(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)
roomsolid_5 = HBRoomFromSolid(
    geo=flatten(wrietup),
    name=panel_8,
    program="2013::Laboratory::Office",
    constr_set=searchconstrset,
    conditioned=True,
    run=toggle)  # -> report, rooms; plug-in component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

# ----
# Laboratory
panel_9 = Panel("Laboratory")
lab_support = Geometry([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])
roomsolid_6 = HBRoomFromSolid(
    geo=flatten(lab_support),
    name=panel_9,
    program="2013::Laboratory::Open lab",
    constr_set=searchconstrset,
    conditioned=True,
    run=toggle)  # -> report, rooms; plug-in component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

# ----
# Corridor
corridor = Geometry([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])
roomsolid_7 = HBRoomFromSolid(
    geo=flatten(corridor),
    name="Corridor",
    program="2013::MediumOffice::Corridor",
    constr_set=searchconstrset,
    conditioned=True,
    run=toggle)  # -> report, rooms; plug-in component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

# ----
# Storage
panel_10 = Panel("2013::MediumOffice::Storage")
storage = Geometry([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])
roomsolid_8 = HBRoomFromSolid(
    geo=flatten(storage),
    name="Storage",
    program=panel_10,
    constr_set=searchconstrset,
    conditioned=Toggle(False),
    run=toggle)  # -> report, rooms; plug-in component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

allrooms = Data(flatten([roomsolid.rooms, roomsolid_5.rooms, roomsolid_3.rooms, roomsolid_6.rooms, roomsolid_2.rooms, roomsolid_4.rooms, roomsolid_7.rooms, roomsolid_8.rooms]))

# ----
# Blend ProgramTypes
panel_11 = Panel("""2013::LargeOffice::ClosedOffice
2013::LargeOffice::Conference
2013::LargeOffice::Corridor
2013::LargeOffice::IT_Room
2013::LargeOffice::OpenOffice
2013::LargeOffice::PrintRoom
2013::LargeOffice::Restroom
2013::LargeOffice::Storage""")
panel_12 = Panel("""0.05
0.15
0.2
0.05
0.4
0.05
0.05
0.05""")
blendprograms = HBBlendProgramTypes(name="FullBuildingOffice", programs=panel_11, ratios=panel_12)  # -> program; plug-in component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

# ----
# Solve Adjacency
solveadj = HBSolveAdjacency(rooms=flatten(allrooms), run=toggle)  # -> report, adj_rooms; plug-in component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

facparam = HBFacadeParameters(north=0, east=Toggle(False), south=0, west=Toggle(True))  # -> fac_par; plug-in component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

facparam_2 = HBFacadeParameters(north="0.5", east="1", south="0.5", west="1")  # -> fac_par; plug-in component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

facparam_3 = HBFacadeParameters(north="0", east="45", south="0", west="-45")  # -> fac_par; plug-in component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

# ----
# Generate Facade
panel_13 = Panel("0.35")
aperturesbyratio = HBAperturesByRatio(hb_objs=flatten(solveadj.adj_rooms), ratio=panel_13, win_height="2.8", run=toggle)  # -> report, hb_objs; plug-in component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
louvershades = HBLouverShades(
    hb_objs=flatten(aperturesbyratio.hb_objs),
    depth=facparam_2,
    angle=facparam_3,
    vertical=Toggle(True),
    flip_start=facparam,
    run=toggle)  # -> report, hb_objs; plug-in component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

# ----
# Search Construction/Material Libraries
searchconstrs = HBSearchConstructions()  # -> opaque_constrs, window_constrs, shade_constrs; plug-in component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
searchmats = HBSearchMaterials()  # -> opaque_mats, window_mats; plug-in component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
panel_14 = Panel(searchconstrs.opaque_constrs)

# ----
# Deconstruct ConstructionSet, Constructions, Materials
construction_set = Data(searchconstrset_2)
decnstrconstrsetint = HBDeconstructConstructionSetInterior(constr_set=construction_set)  # -> interior_wall, ceiling, interior_floor, interior_window, interior_door, int_glass_door; plug-in component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
decnstrconstrset = HBDeconstructConstructionSet(constr_set=construction_set)  # -> exterior_wall, exterior_roof, exposed_floor, ground_wall, ground_roof, ground_floor, window, skylight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; plug-in component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
panel_15 = Panel(decnstrconstrset.exterior_wall)
panel_16 = Panel(decnstrconstrsetint.ceiling)
decnstrconstr = HBDeconstructConstruction(constr=decnstrconstrset.exterior_wall)  # -> materials, layers, r_val_si, r_val_ip, u_fac_si, u_fac_ip, t_sol, t_vis; plug-in component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
panel_17 = Panel(decnstrconstr.t_sol)
panel_18 = Panel(decnstrconstr.r_val_ip)
panel_19 = Panel(decnstrconstr.layers)
decnstrmat = HBDeconstructMaterial(mat=decnstrconstr.materials)  # -> values, attr_names, r_val_si, r_val_ip; plug-in component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
panel_20 = Panel(decnstrmat.values)
panel_21 = Panel(decnstrmat.attr_names)

# ----
# Create Constructions
panel_22 = Panel("Generic Window Argon Gap")
merge = Merge(Data1="1IN Stucco", Data2="Typical Insulation-R10", Data3="Generic Wall Air Gap", Data4="1/2 in. Gypsum Board")
merge_2 = Merge(Data1="Generic Low-e Glass", Data2=panel_22, Data3="Generic Clear Glass")
opaqueconstr = HBOpaqueConstruction(name="Custom Cosntruction", materials=merge)  # -> constr; plug-in component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
shadeconstr = HBShadeConstruction(name="Glass Facade", sol_ref="0.3", vis_ref="0.3", specular=Toggle(True))  # -> constr; plug-in component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
windowconstr = HBWindowConstruction(name="HighInsulationGlass", materials=merge_2)  # -> constr; plug-in component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
panel_23 = Panel(windowconstr)
panel_24 = Panel(shadeconstr)
panel_25 = Panel(opaqueconstr)

# ----
# Deconstruct and Assign Programs/Loads
deconstrprogram = HBDeconstructProgramType(program=blendprograms)  # -> people, lighting, electric_equip, gas_equip, infiltration, ventilation, setpoint; plug-in component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
applyprogram = HBApplyProgramType()  # -> report, rooms; plug-in component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
applyloadvals = HBApplyLoadValues()  # -> report, mod_obj; plug-in component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
applysetpointvals = HBApplySetpointValues()  # -> report, mod_obj; plug-in component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

# ----
# Make Adiabatic
adiabaticbytype = HBAdiabaticByType()  # -> hb_objs; plug-in component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

# ----
# Create Schedules
dayschedule = HBDaySchedule(
    Decimals=1,
    Maximum=1,
    Minimum=0,
    Value=[0, 0, 0, 0, 0, 0, 0, 0, 0, 0.1, 0.3, 0.3, 0.3, 0.3, 0.3, 0.3, 0.2, 0.1, 0, 0, 0, 0, 0, 0])
dayschedule_2 = HBDaySchedule(
    Decimals=1,
    Maximum=1,
    Minimum=0,
    Value=[0, 0, 0, 0, 0, 0, 0, 0.1, 0.8, 1, 1, 1, 1, 1, 1, 1, 1, 0.8, 0.3, 0.3, 0.1, 0, 0, 0])
dayschedule_3 = HBDaySchedule(
    Decimals=1,
    Maximum=1,
    Minimum=0,
    Value=[0, 0, 0, 0, 0, 0, 0, 0.1, 0.8, 1, 1, 1, 1, 1, 1, 1, 1, 0.8, 0.3, 0.3, 0.1, 0, 0, 0])
genepooltodaysch = HBGenePoolToDaySchedule(gene_pool=dayschedule_2, run=Toggle(False))  # -> report; plug-in component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
constantschedule = HBConstantSchedule(values=dayschedule_2, name="OfficeOccupancyCrunchTime")  # -> report, schedule, idf_text; plug-in component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
weeklyschedule = HBWeeklySchedule(
    sun="0",
    mon=dayschedule_3,
    tue=dayschedule_3,
    wed=dayschedule_3,
    thu=dayschedule_3,
    fri=dayschedule_3,
    sat=dayschedule,
    name="OfficeOccupancyNormal")  # -> report, schedule, idf_year, idf_week, idf_days; plug-in component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
analysisperiod = LadybugPlus_AnalysisPeriod(start_month="6", start_day=1, start_hour=0, end_month="6")  # -> analysis_period, hoys, dates; plug-in component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
cluster = Cluster()  # -> D, S_2, D_2, S
seasonalschedule = HBSeasonalSchedule(
    base_schedule=weeklyschedule.schedule,
    season_scheds=constantschedule.schedule,
    analysis_periods=analysisperiod.analysis_period,
    name="OfficeOccupancyWithCrunch")  # -> report, schedule, idf_year, idf_week, idf_days; plug-in component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
data = Data([cluster.D, cluster.S_2, cluster.D_2, cluster.S])
fixedintervalschedule = HBFixedIntervalSchedule(values=data, name="GradualTransparencyShift")  # -> report, schedule; plug-in component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
panel_26 = Panel(seasonalschedule.schedule)
panel_27 = Panel(fixedintervalschedule.schedule)

# ----
# Edit the HVAC
toggle_2 = BooleanToggle(True)
idealair = HBIdealAir(rooms=flatten(louvershades.hb_objs), dcv=toggle_2, sensible_hr="0.81", latent_hr="0.75")  # -> report, rooms; plug-in component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

all_rooms = Data(flatten(idealair.rooms))

# ----
# Visualize Rooms
faceenergyattr = HBFaceEnergyAttributes({"Construction": "properties.energy.construction.name", "Materials": "properties.energy.construction.layers", "R-Value": "properties.energy.construction.r_value", "U-Value": "properties.energy.construction.u_value", "U-Factor": "properties.energy.construction.u_factor", "Solar Transmitance [Unshaded]": "properties.energy.construction.unshaded_solar_transmittance", "Solar Reflectance [Outside]": "properties.energy.construction.outside_solar_reflectance", "Solar Reflectance [Inside]": "properties.energy.construction.inside_solar_reflectance"}, selected="Construction")
roomenergyattr = HBRoomEnergyAttributes({"Program": "properties.energy.program_type.name", "Construction Set": "properties.energy.construction_set.name", "Is Conditioned": "properties.energy.is_conditioned", "People per Area [ppl/m2]": "properties.energy.people.people_per_area", "Area per Person [m2/ppl]": "properties.energy.people.area_per_person", "Lighting per Area [W/m2]": "properties.energy.lighting.watts_per_area", "Electric Equipment per Area [W/m2]": "properties.energy.electric_equipment.watts_per_area", "Gas Equipment per Area [W/m2]": "properties.energy.gas_equipment.watts_per_area", "Infiltration per Exterior Area [m3/s-m2]": "properties.energy.infiltration.flow_per_exterior_area", "Ventilation per Person [m3/s-ppl]": "properties.energy.ventilation.flow_per_person"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}, selected="Program")
lablefaces = HBLabelFaces(hb_obj=flatten(all_rooms), attribute=faceenergyattr, sub_faces=Toggle(False))  # -> label_text, base_pts, labels, wire_frame; plug-in component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
labelrooms = HBLabelRooms(rooms=flatten(all_rooms), attribute=roomenergyattr)  # -> label_text, base_pts, labels, wire_frame; plug-in component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

deconstrprogram_2 = HBDeconstructProgramType(program="2013::MediumOffice::ClosedOffice")  # -> people, lighting, electric_equip, gas_equip, infiltration, ventilation, setpoint; plug-in component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
decnstrlighting = HBDeconstructLighting(lighting=deconstrprogram_2.lighting)  # -> name, watts_per_area, schedule, radiant_fract, visible_fract, return_fract; plug-in component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
decnstrpeople = HBDeconstructPeople(people=deconstrprogram_2.people)  # -> name, ppl_per_area, occupancy_sch, activity_sch; plug-in component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
decnstrsetpoint = HBDeconstructSetpoint(setpoint=deconstrprogram_2.setpoint)  # -> name, heating_sch, cooling_sch, humid_setpt, dehumid_setpt; plug-in component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
decnstrequipment = HBDeconstructEquipment(equip=deconstrprogram_2.electric_equip)  # -> name, watts_per_area, schedule, radiant_fract, latent_fract, lost_fract, is_gas; plug-in component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
decnstrinfiltration = HBDeconstructInfiltration(infil=deconstrprogram_2.infiltration)  # -> name, flow_per_ext_area, schedule; plug-in component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
decnstrventilation = HBDeconstructVentilation(vent=deconstrprogram_2.ventilation)  # -> name, flow_per_person, flow_per_area, flow_per_zone, ach, schedule; plug-in component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
deconstrsch = HBDeconstructSchedule(schedule=decnstrpeople.occupancy_sch)  # -> day_names, day_data, type_limit; plug-in component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
xdata = LadybugPlus_DeconstructData(data=deconstrsch.day_data)  # -> header, values; plug-in component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
panel_28 = Panel(xdata.values)

# ----
# Apply Constructions
# to Objects
applyopaqueconstr = HBApplyOpaqueConstruction()  # -> hb_objs; plug-in component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
applywindowconstr = HBApplyWindowConstruction()  # -> hb_objs; plug-in component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
applyshadeconstr = HBApplyShadeConstruction()  # -> hb_objs; plug-in component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
applyconstrset = HBApplyConstructionSet()  # -> rooms; plug-in component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

# ----
# Simulation Parameters
toggle_3 = BooleanToggle(True)
simoutput = HBSimulationOutput(zone_energy_use=toggle_3, summary_reports="AllSummary")  # -> report, sim_output; plug-in component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
simcontrol = HBSimulationControl()  # -> sim_control; plug-in component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
analysisperiod_2 = LadybugPlus_AnalysisPeriod(start_month="1", start_day="1", start_hour=0, end_month="1", end_day="7")  # -> analysis_period, hoys, dates; plug-in component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
shadowcalc = HBShadowCalculation(solar_dist="FullExteriorWithReflections")  # -> shadow_calc; plug-in component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
sizingpar = HBSizingParameter()  # -> sizing; plug-in component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
customoutput = HBCustomSimulationOutput(base_sim_output=simoutput.sim_output, output_names="Zone Mean Air Temperature")  # -> report, sim_output; plug-in component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
simpar = HBSimulationParameter(
    output=customoutput.sim_output,
    run_period=analysisperiod_2.analysis_period,
    timestep=6,
    sim_control=simcontrol,
    shadow_calc=shadowcalc,
    sizing=sizingpar)  # -> sim_par; plug-in component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

# ----
# Download EPW File
panel_29 = Panel("https://www.energyplus.net/weather-download/north_and_central_america_wmo_region_4/USA/MA/USA_MA_Boston-Logan.Intl.AP.725090_TMY3/all")
downloadweather = LadybugPlus_DownloadWeather(weather_URL=panel_29)  # -> epw_file, stat_file, ddy_file; plug-in component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

# ----
# Create the Model
panel_30 = Panel("LabBuilding")
model = HBModel(rooms=flatten(all_rooms), north="10", name=panel_30)  # -> report, model; plug-in component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

# ----
# Create Materials
panel_31 = Panel("Custom Window System")
panel_32 = Panel("""Argon
Air""")
panel_33 = Panel("""0.9
0.1""")
customgapmat = HBCustomWindowGapMaterial(
    name="Carbon Dioxide",
    thickness="0.0125",
    conductivity_a="0.0001",
    viscosity_a="0.000014",
    specific_heat_a="827.73",
    spec_heat_ratio="1.4",
    mol_weight="44")  # -> mat; plug-in component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
glassmat = HBGlassMaterial(name="Safety Glass", thickness="0.02")  # -> mat; plug-in component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
blindmat = HBBlindMaterial(name="WoodenBlind", slat_separation="0.03", slat_thickness="0.01", slat_angle="90", conductivity="0.14")  # -> mat; plug-in component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
shademat = HBShadeMaterial(name="InsulatingShade", thickness="0.02", conductivity="0.02")  # -> mat; plug-in component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
opaquematnomass = HBOpaqueMaterialNoMass(name="NoMassInsulation", r_value="2")  # -> mat; plug-in component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
opaquemat = HBOpaqueMaterial(name="Concrete Custom", thickness="0.25", conductivity="0.7195", density="1856", spec_heat="839.4")  # -> mat; plug-in component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
gapmat = HBWindowGapMaterial(name="Air Argon Mixture", gas_types=panel_32, gas_ratios=panel_33)  # -> mat; plug-in component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
windowmat = HBWindowMaterial(name=panel_31, u_factor="1.25", shgc="0.35")  # -> mat; plug-in component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
panel_34 = Panel(opaquematnomass)
panel_35 = Panel(opaquemat)
panel_36 = Panel(windowmat)
panel_37 = Panel(gapmat)
panel_38 = Panel(customgapmat)
panel_39 = Panel(glassmat)
panel_40 = Panel(shademat)
panel_41 = Panel(blindmat)

# ----
# Deconstruct Schedues
panel_42 = Panel("Monday")
schtodata = HBScheduleToData(schedule=weeklyschedule.schedule, week_start_day=panel_42, holidays="1 Jan")  # -> data; plug-in component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
deconstrsch_2 = HBDeconstructSchedule(schedule=weeklyschedule.schedule)  # -> day_names, day_data, type_limit; plug-in component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

# ----
# Create ScheduleTypeLimits
panel_43 = Panel("Fan Speed")
typelimit = HBTypeLimit(name=panel_43, low_limit="0", unit_type="Velocity")  # -> report, type_limit; plug-in component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
panel_44 = Panel(typelimit.type_limit)

# ----
# Search Schedule Library
searchschs = HBSearchSchedules()  # -> schedules, type_limits; plug-in component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
panel_45 = Panel(searchschs.schedules)

modeltoosm = HBModelToOSM(model=model.model, epw_file=downloadweather.epw_file, write=Toggle(False), run="2")  # -> report, jsons, osw, osm, idf, sql, zsz, rdd, html; plug-in component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
modeltoidf = HBModelToIDF(model=model.model, epw_file=downloadweather.epw_file, write=Toggle(False))  # -> report, idf, sql, zsz, rdd, html; plug-in component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

faceresult = HBReadFaceResult(sql=modeltoidf.sql)  # -> face_indoor_temp, face_outdoor_temp, face_energy_flow, opaque_energy_flow, window_energy_flow; plug-in component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
roomcustomresult = HBReadCustomResult(sql=modeltoidf.sql, output_names="Zone Mean Air Temperature")  # -> results; plug-in component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
roomenergyresult = HBReadRoomEnergyResult(sql=modeltoidf.sql)  # -> cooling, heating, lighting, electric_equip, gas_equip, fan_electric, pump_electric, people_gain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; plug-in component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
roomcomfortresult = HBReadRoomComfortResult(sql=modeltoidf.sql)  # -> oper_temp, air_temp, rad_temp, rel_humidity; plug-in component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

# ----
# Assign Schedues
applyroomsch = HBApplyRoomSchedules()  # -> report, mod_obj; plug-in component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
applyshadesch = HBApplyShadeSchedule()  # -> hb_objs; plug-in component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

panel_46 = Panel("C:\Users\chris\Documents\GitHub\honeybee-grasshopper-energy\honeybee_grasshopper_energy")
createuo = LBCreateUserObject(folder=panel_46, change_type="feat", export=Toggle(False))  # -> read_me; plug-in component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

# ==== cluster Cluster
division = Division(A="1", B="2190")
neg = Negative(Value=division)
dup = DuplicateData(Data="0", Number="2190", Order=True)
dup_2 = DuplicateData(Data="1", Number="2190", Order=True)
series = Series(Start="1", Step=neg, Count="2190")
series_2 = Series(Start=0, Step=division, Count="2190")
S = ClusterOutput(series)
S_2 = ClusterOutput(series_2)
D = ClusterOutput(dup)
D_2 = ClusterOutput(dup_2)
