# Grasshopper definition photovoltaics.gh (Grasshopper 1.0.7)

panel = Panel("2019::MidriseApartment::Apartment")
panel_2 = Panel("2019::ClimateZone5::WoodFramed")
main_house = Geometry(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)
roomsolid = HBRoomFromSolid(geo=flatten(main_house), constr_set=panel_2, program=panel, conditioned=True)  # -> report, rooms; plug-in component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
aperturesbyratio = HBAperturesByRatio(hb_objs=flatten(roomsolid.rooms), ratio="0.4", subdivide=Toggle(False))  # -> report, hb_objs; plug-in component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

attic = Geometry(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)
roomsolid_2 = HBRoomFromSolid(geo=flatten(attic), constr_set=panel_2, program=panel, conditioned=True)  # -> report, rooms; plug-in component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
plenum = HBPlenum(rooms=roomsolid_2.rooms)  # -> rooms; plug-in component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

ground_pv = Geometry(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)
shade = HBShade(geo=ground_pv)  # -> report, shades; plug-in component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
photovoltaic = HBPhotovoltaicProperties(shades=shade.shades, rated_efficiency="0.16", mounting_type="FixedOpenRack", name="Ground Mounted Array")  # -> report, shades; plug-in component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
panel_3 = Panel(photovoltaic.report)

trees = Geometry(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)
custom_mesh_settings = SettingsCustom(
    StitchSeams=True,
    SimplePlanes=False,
    Refine=True,
    MinCount=16,
    MaxCount=400,
    AspectRatio=20,
    MaxDistance=0,
    MaxAngle=20,
    MinEdge="2",
    MaxEdge="2")
mesh = MeshBrep(Brep=trees, Settings=custom_mesh_settings)
shade_2 = HBShade(geo=mesh, name="Tree")  # -> report, shades; plug-in component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

context_houses = Geometry([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])
shade_3 = HBShade(geo=context_houses)  # -> report, shades; plug-in component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

shw = HBSHWTemplates({"Gas Water Heater": "Gas_WaterHeater", "Electric Water Heater": "Electric_WaterHeater", "Heat Pump Water Heater": "HeatPump_WaterHeater", "Gas Tankless Heater": "Gas_TanklessHeater", "Electric Tankless Heater": "Electric_TanklessHeater"}, selected="Heat Pump Water Heater")
heatcoolhvac = HBHeatCoolHVAC(rooms=flatten(aperturesbyratio.hb_objs), system_type="VRF")  # -> report, rooms; plug-in component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
shw_2 = HBSHWSystem(rooms=flatten(heatcoolhvac.rooms), system_type=shw, condition=roomsolid.rooms)  # -> report, rooms; plug-in component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

solveadj = HBSolveAdjacency(rooms=flatten([shw_2.rooms, plenum]), run=Toggle(True))  # -> report, adj_rooms; plug-in component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

panel_4 = Panel("https://energyplus-weather.s3.amazonaws.com/north_and_central_america_wmo_region_4/USA/NY/USA_NY_New.York-J.F.Kennedy.Intl.AP.744860_TMY3/USA_NY_New.York-J.F.Kennedy.Intl.AP.744860_TMY3.zip")
downloadepw = LBDownloadWeather(weather_URL=panel_4)  # -> epw_file, stat_file, ddy_file; plug-in component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

toggle = BooleanToggle(False)

roof_pv = Geometry(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)
shade_4 = HBShade(geo=roof_pv)  # -> report, shades; plug-in component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

photovoltaic_2 = HBPhotovoltaicProperties(shades=shade_4.shades, rated_efficiency="0.16", mounting_type="FixedRoofMounted", name="Rooftop Array")  # -> report, shades; plug-in component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

panel_5 = Panel(photovoltaic_2.report)

model = HBModel(
    rooms=flatten(solveadj.adj_rooms),
    shades=flatten([photovoltaic_2.shades, photovoltaic.shades, shade_2.shades, shade_3.shades]))  # -> report, model; plug-in component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

electriccenter = HBElectricLoadCenter(model=model.model, dc_to_ac_size="1.25")  # -> model; plug-in component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

vizbytype = HBVisualizeByType(hb_objs=electriccenter)  # -> walls, interior_walls, roofs, ceilings, exterior_floors, interior_floors, air_walls, apertures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; plug-in component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
modeltoosm = HBModelToOSM(model=electriccenter, epw_file=downloadepw.epw_file, write=toggle, run=toggle)  # -> report, jsons, osw, osm, idf, sql, zsz, rdd, html; plug-in component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
generationresult = HBReadGenerationResult(sql=modeltoosm.sql)  # -> site_totals, utility_totals, production, consumption, dc_power; plug-in component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

hourlyplot = LBHourlyPlot(data=generationresult.dc_power, base_pt="100, -150, 0")  # -> report, mesh, legend, borders, labels, title, vis_set; plug-in component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

production_and_consumption_kwh = Panel(generationresult.site_totals)

arithop = LBArithmeticOperation(data_1=generationresult.consumption, data_2="-1", operator="*", type="Electricity Consumption")  # -> data; plug-in component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

monthlychart = LBMonthlyChart(data=flatten([generationresult.production, arithop]), base_pt="100, 0, 0")  # -> report, data_mesh, data_lines, col_lines, legend, borders, labels, y_title, title, vis_set; plug-in component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
