# Grasshopper definition radiant_asymmetry_discomfort.gh (Grasshopper 1.0.7)

honeybee = Honeybee_Honeybee()  # -> Vviiiiiiiiiizzz; plug-in component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
ladybug = Ladybug_Ladybug()  # -> Vviiiiiiiiiizzz; plug-in component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

# ---- group: EPW File and Period
# INPUTS
panel = Panel("https://energyplus-weather.s3.amazonaws.com/north_and_central_america_wmo_region_4/USA/IL/USA_IL_Chicago-OHare.Intl.AP.725300_TMY3/USA_IL_Chicago-OHare.Intl.AP.725300_TMY3.zip")
analysisperiod = LBAnalysisPeriod(start_month="12", start_day=1, start_hour=0, end_month="12")  # -> period, hoys, dates; plug-in component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
downloadepw = LBDownloadWeather(weather_URL=panel)  # -> epw_file, stat_file, ddy_file; plug-in component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

# ---- group: Occupant Location
occupantlocation = Point(Point(5, 9, 0.5))
xz = XZPlane(Origin=occupantlocation)

# ---- group: Test Box Geometry
testzone_geometry = Geometry(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)
glazing_geometry = Geometry(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)

# ---- group: Window Construction
panel_2 = Panel("""Generic Double Pane
Generic Single Pane""")
item = ListItem(List=panel_2, Index=Slider(1, range=0..1), Wrap=True)

# ---- group: Split Zone With Occupant Location Plane
sec = BrepPlane(Brep=testzone_geometry, Plane=xz)  # -> Curves, Points
split = SplitBrep(Brep=testzone_geometry, Cutter=sec.Curves)
join = BrepJoin(Breps=split)  # -> Breps, Closed

# ---- group: Creat Test Zone
roomsolid = HBRoomFromSolid(geo=flatten(join.Breps), program="2019::MidriseApartment::Apartment", conditioned=True)  # -> report, rooms; plug-in component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
aperture = HBAperture(geo=glazing_geometry, ep_constr=item)  # -> report, apertures; plug-in component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
addsubface = HBAddSubface(hb_obj=flatten(roomsolid.rooms), sub_faces=flatten(aperture.apertures))  # -> hb_obj; plug-in component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
toggle = BooleanToggle(True)
facparam = HBFacadeParameters(north=0, east=toggle, south=toggle, west=toggle)  # -> fac_par; plug-in component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
adiabaticbytype = HBAdiabaticByType(hb_objs=flatten(addsubface), exterior_walls=facparam, roofs=toggle, exposed_floors=toggle)  # -> hb_objs; plug-in component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
applysetpointvals = HBApplySetpointValues(room_or_program=flatten(adiabaticbytype), cooling_setpt="25", heating_setpt="23")  # -> report, mod_obj; plug-in component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
model = HBModel(rooms=flatten(applysetpointvals.mod_obj))  # -> report, model; plug-in component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
vizwiref = HBVisualizeWireframe(hb_objs=flatten(applysetpointvals.mod_obj))  # -> geo; plug-in component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

# ----
simoutput = HBSimulationOutput(surface_temperature=Toggle(True))  # -> report, sim_output; plug-in component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
simpar = HBSimulationParameter(output=simoutput.sim_output, run_period=analysisperiod.period, timestep=6)  # -> sim_par; plug-in component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

# ----
# 1
# Run Energy Simulation
toggle_2 = BooleanToggle(False)
modeltoosm = HBModelToOSM(model=model.model, epw_file=downloadepw.epw_file, sim_par=simpar, write=toggle_2, run=toggle_2)  # -> report, jsons, osw, osm, idf, sql, zsz, rdd, html; plug-in component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
faceresult = HBReadFaceResult(sql=modeltoosm.sql)  # -> face_indoor_temp, face_outdoor_temp, face_energy_flow; plug-in component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

colorfaces = HBColorFaces(data=flatten(faceresult.face_indoor_temp), hb_objs=flatten(model.model))  # -> report, mesh, wire_frame, legend, title, faces, colors, values, vis_set; plug-in component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
xdata = LBDeconstructData(data=faceresult.face_indoor_temp)  # -> header, values; plug-in component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
vizquick = HBVisualizeQuick(hb_objs=flatten(colorfaces.faces))  # -> geo; plug-in component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

data = Data(colorfaces.values)
pt = Point(occupantlocation)
pln = Plane(xz)
# 2
# Calculate View Factors
toggle_3 = BooleanToggle(False)

# ---- group: View Factor Calculation
rotate = Rotate(Geometry=pln, Angle=3.141592654, Plane=pt)  # -> Geometry, Transform
viewfactors = LBViewFactors(study_point=flatten([rotate.Geometry, pln]), view_geo=flatten(vizquick), resolution=Slider(3, range=1..4), run=toggle_3)  # -> report, view_vecs, patch_mesh, view_factors, int_mtx; plug-in component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
bang = ExplodeTree(Data=viewfactors.view_factors)  # -> Branch0, Branch1

# ---- group: Transpose the Matrix of Surface Temperatures
flip = FlipMatrix(Data=xdata.values)

# ----
# Visualize the Average
# Radiant Environment
xmatrix = LBDeconstructMatrix(matrix=flatten(viewfactors.int_mtx))  # -> values; plug-in component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
colrange = LBColorRange(index="0")  # -> flatten(colors); plug-in component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
branch = TreeBranch(Tree=simplify(xmatrix), Path="0", MaintainPaths=True)
item_2 = ListItem(List=data, Index=branch, Wrap=True)
legendpar = LBLegendParameters(colors=[colrange, ColourSwatch(SwatchColor=RGB(255, 255, 255))])  # -> leg_par; plug-in component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
heatmap = LBSpatialHeatmap(
    values=item_2,
    mesh=viewfactors.patch_mesh,
    legend_par=legendpar,
    legend_title="C",
    global_title="Average Radiant Temperature")  # -> mesh, legend, title, colors, legend_par, vis_set; plug-in component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
medges = MeshEdges(Mesh=heatmap.mesh)  # -> NakedEdges, InteriorEdges, NonManifoldEdges

view_factors_to_side_1 = Panel(bang.Branch0)
view_factors_to_side_2 = Panel(bang.Branch1)

# ---- group: Multiply View Factors By Surface Temperature
multiplication = Multiplication(A=flip, B=view_factors_to_side_1)
multiplication_2 = Multiplication(A=flip, B=view_factors_to_side_2)

# ---- group: Calculate the Radaint Temperature on Each Side of the Plane
ma = MassAddition(Input=multiplication_2)  # -> flatten(Result), PartialResults
ma_2 = MassAddition(Input=multiplication)  # -> flatten(Result), PartialResults
radiant_temp_on_side_2 = Panel(ma.Result)
radiant_temp_on_side_1 = Panel(ma_2.Result)

# ----
subtraction = Subtraction(A=radiant_temp_on_side_1, B=radiant_temp_on_side_2)

data_2 = Data(analysisperiod.period)
constrheader = LBConstructHeader(data_type="RadiantTemperatureDelta", unit="dC", a_period=data_2)  # -> header; plug-in component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
data_3 = LBConstructData(header=constrheader, values=subtraction)  # -> data; plug-in component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

# ---- group: Radiant Asymmetry Calculation
radasymm = LBRadiantAsymmetry(radiant_diff=data_3, asymmetry_type="CoolWall")  # -> ppd; plug-in component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

# ----
data_4 = Data([data_3, radasymm])

panel_3 = Panel("""11
3""")
colrange_2 = LBColorRange(index=panel_3)  # -> colors; plug-in component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
legendpar_2 = LBLegendParameters(colors=colrange_2)  # -> flatten(leg_par); plug-in component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
pt_2 = Point(Point(17.35326193, -3.909856785, 0))
hourlyplot = LBHourlyPlot(data=data_4, base_pt=pt_2, x_dim="4", legend_par=legendpar_2)  # -> report, mesh, legend, borders, labels, title, vis_set; plug-in component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
