# Grasshopper definition run_energy_models_in_parallel.gh (Grasshopper 1.0.8)

# ---- group: Set up a range of glazing ratios
series = Series(Start="0.1", Step="0.1", Count="9")
panel = Panel(series)

# ----
# Create Honeybee Model
panel_2 = Panel("2019::LargeOffice::ClosedOffice")
geo = Geometry(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)
roomsolid = HBRoomFromSolid(
    geo=flatten(geo),
    name="Office Shoe Box",
    constr_set="2019::ClimateZone5::SteelFramed",
    program=panel_2,
    conditioned=True)  # -> report, rooms; plug-in component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
facparam = HBFacadeParameters(north=0, east=0, south=series, west=0)  # -> fac_par; plug-in component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
toggle = BooleanToggle(True)
aperturesbyratio = HBAperturesByRatio(hb_objs=flatten(roomsolid.rooms), ratio=facparam, subdivide=Toggle(False))  # -> report, hb_objs; plug-in component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
facparam_2 = HBFacadeParameters(north=toggle, east=toggle, south=0, west=toggle)  # -> fac_par; plug-in component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
all_air = HBAllAirHVACTemplates({"VAV chiller with gas boiler reheat": "VAV_Chiller_Boiler", "VAV chiller with central air source heat pump reheat": "VAV_Chiller_ASHP", "VAV chiller with district hot water reheat": "VAV_Chiller_DHW", "VAV chiller with PFP boxes": "VAV_Chiller_PFP", "VAV chiller with gas coil reheat": "VAV_Chiller_GasCoil", "VAV air-cooled chiller with gas boiler reheat": "VAV_ACChiller_Boiler", "VAV air-cooled chiller with central air source heat pump reheat": "VAV_ACChiller_ASHP", "VAV air-cooled chiller with district hot water reheat": "VAV_ACChiller_DHW", "VAV air-cooled chiller with PFP boxes": "VAV_ACChiller_PFP", "VAV air-cooled chiller with gas coil reheat": "VAV_ACChiller_GasCoil"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}, selected="VAV chiller with gas boiler reheat")
adiabaticbytype = HBAdiabaticByType(hb_objs=flatten(aperturesbyratio.hb_objs), exterior_walls=facparam_2, roofs=toggle, exposed_floors=toggle)  # -> hb_objs; plug-in component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
allairhvac = HBAllAirHVAC(rooms=flatten(adiabaticbytype), system_type=all_air, name="VAV System", economizer="DifferentialDryBulb")  # -> report, rooms; plug-in component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
concat = Concatenate(FragmentA="ShoeBox_Glz", FragmentB=series)
model = HBModel(rooms=simplify(graft(allairhvac.rooms)), name=simplify(graft(concat)))  # -> report, flatten(model); plug-in component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
vizwiref = HBVisualizeWireframe(hb_objs=flatten(model.model))  # -> geo; plug-in component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

# ----
# Download EPW File
panel_3 = Panel("https://energyplus-weather.s3.amazonaws.com/north_and_central_america_wmo_region_4/USA/MA/USA_MA_Boston-Logan.Intl.AP.725090_TMY3/USA_MA_Boston-Logan.Intl.AP.725090_TMY3.zip")
downloadepw = LBDownloadWeather(weather_URL=panel_3)  # -> epw_file, stat_file, ddy_file; plug-in component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

multiple_models_to_run = Panel(model.model)
# Write OSM Files
toggle_2 = BooleanToggle(True)
modeltoosm = HBModelToOSM(model=model.model, epw_file=downloadepw.epw_file, write=toggle_2)  # -> report, jsons, osw, osm, idf, sql, zsz, rdd, html; plug-in component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
# Run OSM in Parallel
toggle_3 = BooleanToggle(True)
runosm = HBRunOSM(osm=modeltoosm.osm, epw_file=downloadepw.epw_file, translate=toggle_3, run=toggle_3)  # -> report, idf, sql, zsz, rdd, html; plug-in component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

# ----
# Load EUI
eui = HBEndUseIntensity(sql=graft(runosm.sql))  # -> flatten(eui), eui_end_use, end_uses, gross_floor; plug-in component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
eui_kwh_m2 = Panel(eui.eui)
