# Grasshopper definition shoe_box_peak_loads.gh (Grasshopper 1.0.7)

# ----
# Download EPW File
panel = Panel("https://www.energyplus.net/weather-download/north_and_central_america_wmo_region_4/USA/CA/USA_CA_Los.Angeles.Intl.AP.722950_TMY3/all")
downloadepw = LBDownloadWeather(weather_URL=panel)  # -> epw_file, stat_file, ddy_file; plug-in component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

# ----
# Create Shoe Box
panel_2 = Panel("10")
box = DomainBox(Base=PlaneXY(0, 0, 0), X="10", Y=panel_2, Z="3")
debrep = DeconstructBrep(Brep=box)  # -> Faces, Edges, Vertices
panel_3 = Panel("""0
1
3
4
5""")
item = ListItem(List=debrep.Faces, Index="2", Wrap=True)
item_2 = ListItem(List=debrep.Faces, Index=panel_3, Wrap=True)

# ---- group: Chage Glazing Ratio, Orientation, and Program
number_slider = Slider(0.4, range=0.1..0.9)
number_slider_2 = Slider(270, range=0..360)

# ----
# Select a Design Day to Simulate
number_slider_3 = Slider(6, range=0..17)
importddy = LBImportDDY(ddy_file=downloadepw.ddy_file)  # -> location, design_days; plug-in component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
item_3 = ListItem(List=importddy.design_days, Index=number_slider_3, Wrap=True)
panel_4 = Panel(item_3)
writeddy = DFWriteDDY(location=importddy.location, design_days=item_3, run=Toggle(True))  # -> ddy_file; plug-in component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

# ----
# Create Honeybee Room
panel_5 = Panel("outdoors")
geo = Geometry(item)
geo_2 = Geometry(item_2)
face = HBFace(geo=geo, bc=panel_5)  # -> report, faces; plug-in component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
face_2 = HBFace(geo=geo_2, bc="adiabatic")  # -> report, faces; plug-in component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
aperturesbyratio = HBAperturesByRatio(hb_objs=flatten(face.faces), ratio=number_slider, subdivide=Toggle(False))  # -> report, hb_objs; plug-in component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
room = HBRoom(
    faces=flatten([face_2.faces, aperturesbyratio.hb_objs]),
    name="Hospital Shoe Box",
    constr_set="2013::ClimateZone5::SteelFramed",
    program="2013::LargeOffice::OpenOffice",
    conditioned=True)  # -> report, room; plug-in component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
rotate = HBRotate(hb_objs=flatten(room.room), angle=number_slider_2)  # -> hb_objs; plug-in component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

# ----
# Setup Simulation Just for Design Day Loads
toggle = BooleanToggle(True)
toggle_2 = BooleanToggle(True)
simoutput = HBSimulationOutput(
    zone_energy_use=toggle,
    gains_and_losses=toggle,
    surface_energy_flow=toggle,
    load_type="Sensible",
    report_frequency="Timestep")  # -> report, sim_output; plug-in component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
simcontrol = HBSimulationControl(
    do_zone_sizing=toggle_2,
    do_system_sizing=toggle_2,
    do_plant_sizing=toggle_2,
    for_sizing_period=toggle_2,
    for_run_period=Toggle(False))  # -> sim_control; plug-in component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
sizingpar = HBSizingParameter(ddy_file=writeddy)  # -> sizing; plug-in component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
simpar = HBSimulationParameter(output=simoutput.sim_output, timestep=6, sim_control=simcontrol, sizing=sizingpar)  # -> sim_par; plug-in component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

model = HBModel(rooms=flatten(rotate))  # -> report, model; plug-in component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

# ---- group: Run Me!
toggle_3 = BooleanToggle(False)

# ----
modeltoosm = HBModelToOSM(model=model.model, epw_file=downloadepw.epw_file, sim_par=simpar, write=toggle_3, run=toggle_3)  # -> report, jsons, osw, osm, idf, sql, zsz, rdd, html; plug-in component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

# ----
# Process Results into a Load Balance
roomenergyresult = HBReadRoomEnergyResult(sql=modeltoosm.sql)  # -> cooling, heating, lighting, electric_equip, gas_equip, hot_water, fan_electric, pump_electric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; plug-in component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
faceresult = HBReadFaceResult(sql=modeltoosm.sql)  # -> face_indoor_temp, face_outdoor_temp, face_energy_flow; plug-in component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
readzsz = HBReadZoneSizing(zsz=modeltoosm.zsz)  # -> cooling_load, heating_load; plug-in component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
replace = ReplacePaths(Data=simplify(readzsz.cooling_load), Search="{0;0;0}", Replace="{1}")
loadbalance = HBThermalLoadBalance(
    rooms_model=flatten(model.model),
    lighting=roomenergyresult.lighting,
    electric_equip=roomenergyresult.electric_equip,
    people_gain=roomenergyresult.people_gain,
    solar_gain=roomenergyresult.solar_gain,
    infiltration_load=roomenergyresult.infiltration_load,
    face_energy_flow=faceresult.face_energy_flow)  # -> report, balance, balance_storage, norm_bal, norm_bal_storage; plug-in component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
rate = LBTimeRateOfChange(data=loadbalance.balance)  # -> data_rate; plug-in component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
replace_2 = ReplacePaths(Data=simplify(rate), Search="{0;0;0}", Replace="{0}")
data = Data([replace_2, replace])

# ----
# Create Legend Parameters
swatch = ColourSwatch(SwatchColor=RGB(37, 93, 153))
col = Colour([swatch, ColourSwatch(SwatchColor=RGB(37, 93, 153))])
col_2 = Colour([ColourSwatch(SwatchColor=RGB(255, 251, 0)), ColourSwatch(SwatchColor=RGB(204, 204, 204)), ColourSwatch(SwatchColor=RGB(255, 242, 140)), ColourSwatch(SwatchColor=RGB(255, 212, 0)), ColourSwatch(SwatchColor=RGB(135, 178, 224)), ColourSwatch(SwatchColor=RGB(255, 175, 46)), ColourSwatch(SwatchColor=RGB(255, 0, 0))])
replace_3 = ReplacePaths(Data=simplify(col), Search="{0}", Replace="{1}")
legendpar = LBLegendParameters(min="0", max="8000", seg_count="9", colors=[col_2, replace_3], num_decimals="0")  # -> leg_par; plug-in component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

# ----
# Plot Results on Monthly Chart
panel_6 = Panel("""0,50,0
0,0,0""")
data_2 = Data(simplify(graft(panel_6)))
monthlychart = LBMonthlyChart(data=data, base_pt=data_2, x_dim="40", stack=Toggle(True), legend_par=legendpar)  # -> report, data_mesh, data_lines, legend, borders, labels, y_title, title; plug-in component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
