# Grasshopper definition single_family_comfort_study.gh (Grasshopper 1.0.7)

# ----
# Setup Model
toggle = BooleanToggle(True)
geo = Geometry([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])
intsolid = HBIntersectSolids(solids=flatten(geo), run=toggle)  # -> int_solids; plug-in component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
geo_2 = Geometry([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])
aperture = HBAperture(geo=geo_2, operable=Toggle(True))  # -> report, apertures; plug-in component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
roomsolid = HBRoomFromSolid(
    geo=flatten(intsolid),
    name="Residence",
    constr_set="2004::ClimateZone3::SteelFramed",
    program="2013::MidriseApartment::Apartment",
    conditioned=True)  # -> report, rooms; plug-in component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
bordershades = HBExtrudedBorderShades(hb_objs=flatten(aperture.apertures), depth="0.3")  # -> report, hb_objs; plug-in component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
applysetpointvals = HBApplySetpointValues(room_or_program=flatten(roomsolid.rooms), cooling_setpt="40", heating_setpt="21")  # -> report, mod_obj; plug-in component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
addsubface = HBAddSubface(hb_obj=flatten(applysetpointvals.mod_obj), sub_faces=flatten(bordershades.hb_objs))  # -> hb_obj; plug-in component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
ventcontrol = HBVentilationControl(min_in_temp="22", min_out_temp="12", delta_temp="0")  # -> vent_cntrl; plug-in component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
windowopen = HBWindowOpening(rooms=flatten(addsubface), vent_cntrl=ventcontrol)  # -> report, rooms; plug-in component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
geo_3 = Geometry([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])
shade = HBShade(geo=geo_3)  # -> report, shades; plug-in component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
solveadj = HBSolveAdjacency(rooms=flatten(windowopen.rooms), run=toggle)  # -> report, adj_rooms; plug-in component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

# ----
# Request Outputs
toggle_2 = BooleanToggle(True)
simoutput = HBSimulationOutput(zone_energy_use=toggle_2, comfort_metrics=toggle_2, surface_temperature=toggle_2)  # -> report, sim_output; plug-in component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
analysisperiod = LBAnalysisPeriod(start_month="8", start_day=1, start_hour=0, end_month="8")  # -> period, hoys, dates; plug-in component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
simpar = HBSimulationParameter(output=simoutput.sim_output, run_period=analysisperiod.period, timestep=6)  # -> sim_par; plug-in component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

# ----
# Download EPW File
panel = Panel("http://climate.onebuilding.org/WMO_Region_4_North_and_Central_America/USA_United_States_of_America/CA_California/USA_CA_Burbank-Hope.AP.722880_TMY3.zip")
downloadepw = LBDownloadWeather(weather_URL=panel)  # -> epw_file, stat_file, ddy_file; plug-in component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

shw = HBSHWTemplates({"Gas Water Heater": "Gas_WaterHeater", "Electric Water Heater": "Electric_WaterHeater", "Heat Pump Water Heater": "HeatPump_WaterHeater", "Gas Tankless Heater": "Gas_TanklessHeater", "Electric Tankless Heater": "Electric_TanklessHeater"}, selected="Gas Water Heater")
house_shades = Data(flatten(shade.shades))
house_rooms = Data(flatten(solveadj.adj_rooms))

# ----
# Create Model
panel_2 = Panel("single_family_home")
model = HBModel(rooms=flatten(house_rooms), shades=flatten(house_shades), name=panel_2)  # -> report, model; plug-in component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

shw_2 = HBSHWSystem(rooms=flatten(solveadj.adj_rooms), system_type=shw)  # -> report, rooms; plug-in component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
toggle_3 = BooleanToggle(False)
modeltoosm = HBModelToOSM(model=model.model, epw_file=downloadepw.epw_file, sim_par=simpar, write=toggle_3, run=toggle_3)  # -> report, jsons, osw, osm, idf, sql, zsz, rdd, html; plug-in component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
importepw = LBImportEPW(epw_file=downloadepw.epw_file)  # -> location, dry_bulb_temperature, dew_point_temperature, relative_humidity, wind_speed, wind_direction, direct_normal_rad, diffuse_horizontal_rad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; plug-in component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
data = Data(model.model)

faceresult = HBReadFaceResult(sql=modeltoosm.sql)  # -> face_indoor_temp, face_outdoor_temp, face_energy_flow; plug-in component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
roomcomfortresult = HBReadRoomComfortResult(sql=modeltoosm.sql)  # -> oper_temp, air_temp, rad_temp, rel_humidity; plug-in component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

# ----
# Scroll Through
# Hours of the Day
number_slider = Slider(15, range=0..23)
analysisperiod_2 = LBAnalysisPeriod(start_month="8", start_day=1, start_hour=number_slider, end_month="8", end_hour=number_slider)  # -> period, hoys, dates; plug-in component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

toggle_4 = BooleanToggle(True)

legendpar = LBLegendParameters(min="20", max="30", num_decimals="0")  # -> leg_par; plug-in component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

# ----
# Perform an Hourly Comfort Study
adaptive = LBAdaptiveComfort(
    out_temp=importepw.dry_bulb_temperature,
    air_temp=roomcomfortresult.air_temp,
    mrt=roomcomfortresult.rad_temp,
    run=toggle_4)  # -> report, prevail_temp, neutral_temp, deg_neutral, comfort, condition, comf_obj; plug-in component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
hourlyplot = LBHourlyPlot(data=adaptive.condition, base_pt="30,0,0", x_dim="0.2", y_dim="0.2")  # -> report, mesh, legend, borders, labels, title; plug-in component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

# ----
# Color Geometry
# with Results
colorrooms = HBColorRooms(
    data=flatten(roomcomfortresult.oper_temp),
    rooms_model=flatten(data),
    period=analysisperiod_2.period,
    legend_par=legendpar)  # -> report, mesh, wire_frame, legend, title, rooms, colors, values; plug-in component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
colorfaces = HBColorFaces(data=flatten(faceresult.face_indoor_temp), hb_objs=flatten(data))  # -> report, mesh, wire_frame, legend, title, faces, colors, values; plug-in component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

# ----
# Label with the % of Time Too Hot
comfstat = LBComfortStatistics(comf_obj=adaptive.comf_obj)  # -> pct_hot, pct_neutral, pct_cold; plug-in component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
area = Area(Geometry=colorrooms.mesh)  # -> Area, Centroid
round = Round(Number=comfstat.pct_hot)  # -> Nearest, Floor, Ceiling
concat = Concatenate(FragmentA=round.Nearest, FragmentB="% Hot")
gate = StreamGate(Stream=concat, Gate=toggle_4)  # -> Target0, Target1
tag = TextTag3D(Location=area.Centroid, Text=gate.Target1, Size="0.5", Justification="5")
