# Grasshopper definition single_family_energy_model.gh (Grasshopper 1.0.7)

# ----
# Setup Model
toggle = BooleanToggle(True)
geo = Geometry([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])
intsolid = HBIntersectSolids(solids=flatten(geo), run=toggle)  # -> int_solids; plug-in component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
geo_2 = Geometry([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])
aperture = HBAperture(geo=geo_2)  # -> report, apertures; plug-in component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
roomsolid = HBRoomFromSolid(
    geo=flatten(intsolid),
    name="Residence",
    program="2013::MidriseApartment::Apartment",
    constr_set="2013::ClimateZone5::SteelFramed",
    conditioned=True,
    run=toggle)  # -> report, rooms; plug-in component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
bordershades = HBExtrudedBorderShades(hb_objs=flatten(aperture.apertures), depth="0.3", run=Toggle(True))  # -> report, hb_objs; plug-in component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
addsubface = HBAddSubface(hb_obj=roomsolid.rooms, sub_faces=flatten(bordershades.hb_objs))  # -> hb_obj; plug-in component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
geo_3 = Geometry([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])
solveadj = HBSolveAdjacency(rooms=flatten(addsubface), run=toggle)  # -> report, adj_rooms; plug-in component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
shade = HBShade(geo=geo_3)  # -> report, shades; plug-in component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
house_shades = Data(flatten(shade.shades))
house_rooms = Data(flatten(solveadj.adj_rooms))

# ----
# Request Outputs
toggle_2 = BooleanToggle(True)
simoutput = HBSimulationOutput(
    zone_energy_use=toggle_2,
    gains_and_losses=toggle_2,
    comfort_metrics=toggle_2,
    surface_temperature=toggle_2,
    surface_energy_flow=toggle_2,
    report_frequency="Monthly")  # -> report, sim_output; plug-in component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
simpar = HBSimulationParameter(output=simoutput.sim_output, timestep=6)  # -> sim_par; plug-in component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

# ----
# Download EPW File
panel = Panel("https://www.energyplus.net/weather-download/north_and_central_america_wmo_region_4/USA/MA/USA_MA_Boston-Logan.Intl.AP.725090_TMY3/all")
downloadweather = LadybugPlus_DownloadWeather(weather_URL=panel)  # -> epw_file, stat_file, ddy_file; plug-in component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

# ----
# Create a Model
model = HBModel(rooms=flatten(house_rooms), shades=flatten(house_shades))  # -> report, model; plug-in component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

toggle_3 = BooleanToggle(True)

# ----
# Visualize Model
deconstructmodel = HBDeconstructModel(model=model.model)  # -> rooms, faces, apertures, doors, shades; plug-in component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
vizbytype = HBVisualizeByType(rooms=deconstructmodel.rooms)  # -> walls, interior_walls, roofs, ceilings, exterior_floors, interior_floors, air_walls, apertures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; plug-in component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
vizall = HBVizualizeAll(hb_objs=flatten(deconstructmodel.shades))  # -> geo; plug-in component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
preview = CustomPreview(Geometry=vizbytype.walls, Material=ColourSwatch(SwatchColor=RGB(255, 239, 115)))
preview_2 = CustomPreview(Geometry=vizbytype.interior_walls, Material=ColourSwatch(SwatchColor=RGB(255, 249, 201)))
preview_3 = CustomPreview(Geometry=vizbytype.roofs, Material=ColourSwatch(SwatchColor=RGB(209, 106, 46)))
preview_4 = CustomPreview(Geometry=vizbytype.exterior_floors, Material=ColourSwatch(SwatchColor=RGB(112, 46, 46)))
preview_5 = CustomPreview(Geometry=vizbytype.apertures, Material=ColourSwatch(SwatchColor=RGBA(0, 174, 255, 88)))
preview_6 = CustomPreview(Geometry=vizbytype.outdoor_shades, Material=ColourSwatch(SwatchColor=RGB(255, 238, 112)))
preview_7 = CustomPreview(Geometry=vizall, Material=ColourSwatch(SwatchColor=RGB(184, 184, 184)))

modeltoidf = HBModelToIDF(model=model.model, epw_file=downloadweather.epw_file, sim_par=simpar, write=toggle_3, run=toggle_3)  # -> report, idf, sql, zsz, rdd, html; plug-in component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

faceresult = HBReadFaceResult(sql=modeltoidf.sql)  # -> face_indoor_temp, face_outdoor_temp, face_energy_flow, opaque_energy_flow, window_energy_flow; plug-in component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
roomcustomresult = HBReadCustomResult(sql=modeltoidf.sql, output_names="Zone Mean Air Temperature")  # -> results; plug-in component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
roomenergyresult = HBReadRoomEnergyResult(sql=modeltoidf.sql)  # -> cooling, heating, lighting, electric_equip, gas_equip, fan_electric, pump_electric, people_gain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; plug-in component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
roomcomfortresult = HBReadRoomComfortResult(sql=modeltoidf.sql)  # -> oper_temp, air_temp, rad_temp, rel_humidity; plug-in component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

colorrooms = HBColorRooms(data=flatten(roomenergyresult.cooling), rooms_model=flatten(model.model))  # -> report, mesh, wire_frame, legend, title, rooms, colors, values; plug-in component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
